# Grasshopper definition Cocoon_Ifc_to_Fab.gh (Grasshopper 1.0.7)
# plug-ins: KUKA|prc - parametric robot control, horsterCameraControl, RhinoCodePluginGH

brep = Brep([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])
item = ListItem(List=brep, Index=0, Wrap=True)

# ---- group: brick
crv = Curve(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)
brick = Brep(item)
pt = Point(Point(-468.0396341, 3496.824757, 0))

# ---- group: wall
mesh = Mesh(<mesh referenced from the Rhino model>)
mesh_2 = Mesh(<mesh referenced from the Rhino model>)

# ----
transform_block = Transform_Block(Block=brick, Boundary=mesh)  # -> Block; inputs Block: Mesh
#   port Block: Building block to fill the volume with
#   port Boundary: Volume to be filled with blocks.
# ---------- transform_block: Python ----------
"""

Cocoon: Discrete Assembly Grasshopper Plug-in by Doga Su Kiralioglu
2024
dogasukiralioglu@gmail.com

Construction Robotics Master's Program | Winter Semester 2023-24.
RWTH Aachen University. Special thanks to Prof. Jakob Beetz.

########################## COMPONENT INFO ##########################

Transform_Block
Modifies block based on the given boundary.
-
Provided by Cocoon 0.1
    Args:
        Block: Mesh representing the building block of assembly.
        Boundary: Mesh representing the boundary of the assembly.
    Returns:
        Block: Modified block based on the given boundary.

"""
import System
import Rhino
import Grasshopper

import rhinoscriptsyntax as rs
import Rhino.Geometry as rg
import ghpythonlib.components as ghc

def get_mesh_axis(mesh):
    # Check if the input is a mesh
    if isinstance(mesh, rg.Mesh):
        # Get the bounding box of the mesh
        bounding_box = mesh.GetBoundingBox(False)

        # Extract dimensions from the bounding box
        X = bounding_box.Diagonal.X
        Y = bounding_box.Diagonal.Y

        if X > Y:
            return 1
        else:
            return 0

    else:
        print("Input is not a mesh.")
        return None

a = get_mesh_axis(Block)
b = get_mesh_axis(Boundary)

def copy_and_align(prism1, prism2):

    # check if the unit and boundary are in the same axis 
    if a == b:
        # Extracting corner points of the first prism
        corners1 = rs.BoundingBox(prism1)
        
        # Extracting corner points of the second prism
        corners2 = rs.BoundingBox(prism2)
        
        # Finding the displacement vector
        displacement_vector = corners2[0] - corners1[0]
        
        # Copying the first prism to the corner of the second prism
        copied_prism = rs.CopyObject(prism1, displacement_vector)
        return copied_prism
    else:
        point = rg.Point3d(0, 0, 0)
        prism1 = rs.RotateObject(prism1, point , 90)
        # Extracting corner points of the first prism
        corners1 = rs.BoundingBox(prism1)
        
        # Extracting corner points of the second prism
        corners2 = rs.BoundingBox(prism2)
        
        # Finding the displacement vector
        displacement_vector = corners2[0] - corners1[0]
        
        # Copying the first prism to the corner of the second prism
        copied_prism = rs.CopyObject(prism1, displacement_vector)

        return copied_prism

Block = copy_and_align(Block, Boundary)
# ---------- end transform_block ----------
create_assembly = Create_Assembly(Block=transform_block, Boundary=mesh)  # -> Info, Assembly, Centroids; inputs Block: Mesh
#   port Block: Building block to fill the volume with
#   port Boundary: Volume to be filled with blocks.
# ---------- create_assembly: Python ----------
"""

Cocoon: Discrete Assembly Grasshopper Plug-in by Doga Su Kiralioglu
2024
dogasukiralioglu@gmail.com

Construction Robotics Master's Program | Winter Semester 2023-24.
RWTH Aachen University. Special thanks to Prof. Jakob Beetz.

########################## COMPONENT INFO ##########################

Create_Assembly
Generates a discrete assembly based on the given building blocks and the boundary.
-
Provided by Cocoon 0.1
    Args:
        Block: Mesh representing the building block of assembly.
        Boundary: Mesh representing the boundary of the assembly.
    Returns:
        Info: Errors and execution information.
        Assembly: Discrete assembly of the given blocks.
        Centroids: Center points of blocks in the assembly.

"""

import System
import Rhino
import Grasshopper

import rhinoscriptsyntax as rs
import Rhino.Geometry as rg
import ghpythonlib.components as ghc


# Function to extract dimensions from a rectangular prism mesh
def get_mesh_length(mesh):
    # Check if the input is a mesh
    if isinstance(mesh, rg.Mesh):
        # Get the bounding box of the mesh
        bounding_box = mesh.GetBoundingBox(False)

        # Extract dimensions from the bounding box
        length = bounding_box.Diagonal.X
        width = bounding_box.Diagonal.Y
        height = bounding_box.Diagonal.Z

        if length > width:
            return length
        else:
            return width

    else:
        print("Input is not a mesh.")
        return None

def get_mesh_height(mesh):
    # Check if the input is a mesh
    if isinstance(mesh, rg.Mesh):
        # Get the bounding box of the mesh
        bounding_box = mesh.GetBoundingBox(False)

        # Extract dimensions from the bounding box
        height = bounding_box.Diagonal.Z

        return height

    else:
        print("Input is not a mesh.")
        return None


bound_length = get_mesh_length(Boundary)
block_length = get_mesh_length(Block)

bound_height = get_mesh_height(Boundary)
block_height = get_mesh_height(Block)

num_reps_hor = int(bound_length / block_length)
num_reps_ver = int(bound_height / block_height)

def copy_units(unit_mesh, num_reps_hor):
    # Check if the input is a mesh
    if isinstance(unit_mesh, rg.Mesh):
        # Create a list to store the copies
        single_row = []

        # Duplicate the mesh and append it to the copies list
        for i in range(num_reps_hor):
            copy = rg.Mesh.Duplicate(unit_mesh)
            translation_vector = rg.Vector3d(i * unit_mesh.GetBoundingBox(False).Diagonal.X, 0, 0)
            copy.Translate(translation_vector)
            single_row.append(copy)

        return single_row

    else:
        print("Input is not a mesh.")
        return None

row = copy_units(Block, num_reps_hor)
shift = Block.GetBoundingBox(False).Diagonal.X / 2

def copy_rows(row_meshes, num_reps_ver, row_shift):
    # Check if the input is a list of meshes
    if all(isinstance(mesh, rg.Mesh) for mesh in row_meshes):
        # Create a list to store the copies
        stack_rows = []

        for i in range(num_reps_ver):
            for j, mesh in enumerate(row_meshes):
                copy = mesh.Duplicate()

                # Check if the row index (j) is even
                if i % 2 == 0:
                    translation_vector = rg.Vector3d(row_shift, 0, i * mesh.GetBoundingBox(False).Diagonal.Z)
                else:
                    translation_vector = rg.Vector3d(0, 0, i * mesh.GetBoundingBox(False).Diagonal.Z)

                copy.Translate(translation_vector)
                stack_rows.append(copy)

        return stack_rows

    else:
        print("Input is not a list of meshes.")
        return None

all_copies = copy_rows(row, num_reps_ver, shift)

def get_centroids(meshes):
    if all(isinstance(mesh, rg.Mesh) for mesh in meshes):
        centroids = [mesh.GetBoundingBox(False).Center for mesh in meshes]
        return centroids

result = get_centroids(all_copies)

if result != None:
    print('running smooth...cocoon 0.1.')
    Assembly = all_copies
    Centroids = get_centroids(all_copies)
# ---------- end create_assembly ----------
transform_block_2 = Transform_Block(Block=brick, Boundary=mesh_2)  # -> Block; inputs Block: Mesh; same code as transform_block
create_assembly_2 = Create_Assembly(Block=transform_block_2, Boundary=mesh_2)  # -> Info, Assembly, Centroids; inputs Block: Mesh; same code as create_assembly

# ----
# FAB
panel = Panel(transform_block)
preview = CustomPreview(
    Geometry=create_assembly_2.Assembly,
    Material={diffuse=RGB(221, 160, 221), emission=RGB(66, 48, 66), shine=0.5, specular=RGB(255, 255, 255), transparency=0})
preview_2 = CustomPreview(
    Geometry=create_assembly.Assembly,
    Material={diffuse=RGB(221, 160, 221), emission=RGB(66, 48, 66), shine=0.5, specular=RGB(255, 255, 255), transparency=0})
panel_2 = Panel(create_assembly.Info)
preview_3 = CustomPreview(
    Geometry=create_assembly_2.Centroids,
    Material={diffuse=RGB(221, 160, 221), emission=RGB(66, 48, 66), shine=0.5, specular=RGB(255, 255, 255), transparency=0})

# ----
# MOV
number_slider = Slider(400, range=0..1000)
panel_3 = Panel(create_assembly_2.Assembly)
pt_2 = Point(create_assembly_2.Centroids)
brep_2 = Brep(<brep referenced from the Rhino model>)
geo = Geometry(create_assembly_2.Assembly)
number_slider_2 = Slider(20, range=0..100)
fabrication = Fabrication(pt=pt_2, F=number_slider, G=brep_2)  # -> assembly_planes, D
split = SplitList(List=fabrication.D, Index=number_slider_2)  # -> ListA, ListB
item_2 = ListItem(List=split.ListA, Index=Slider(100, range=0..100), Wrap=True)
ptp_move = PTPMovementKUKAPrc(TargetAsPlane=split.ListA, extaxenabled=False, interpolation="C_PTP")

# ----
# MOV
number_slider_3 = Slider(400, range=0..1000)
pt_3 = Point(create_assembly.Centroids)
brep_3 = Brep(<brep referenced from the Rhino model>)
geo_2 = Geometry(create_assembly.Assembly)
number_slider_4 = Slider(20, range=0..100)
fabrication_2 = Fabrication(pt=pt_3, F=number_slider_3, G=brep_3)  # -> assembly_planes, D
split_2 = SplitList(List=fabrication_2.D, Index=number_slider_4)  # -> ListA, ListB
item_3 = ListItem(List=split_2.ListA, Index=Slider(100, range=0..100), Wrap=True)
ptp_move_2 = PTPMovementKUKAPrc(TargetAsPlane=split_2.ListA, extaxenabled=False, interpolation="C_PTP")

# ----
# Camera Control
# VIS
kr60l30 = KR60L30HARobot(infiniterot=False)
kr90_kr150_r3700k = QuantecKR90KR150R3700KRobot(infiniterot=False)
kr210_r3100_2 = Quantec2KR210R3100Robot(infiniterot=False)
kr3_r540 = AgilusKR3R540Robot(infiniterot=False)
kmp_200 = KMP200MobilePlatformKUKAPrc(KUKAPrcRobotInput=kr60l30)
number_slider_5 = Slider(1, range=0..1)
division = Division(A=number_slider_4, B="6")
kuka_prc = KUKAPrcCORE(
    SimulationSlider=number_slider_5,
    KUKAPrcCommands=ptp_move_2,
    Robot=kmp_200,
    PRC_BaseExpose=False,
    PRC_SaveNameExpose=False,
    PRCsettings="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")  # -> RobotGeometry, AnalysisOutput
split_3 = SplitList(List=geo_2, Index=division)  # -> ListA, ListB
crv_2 = Curve(<curve referenced from the Rhino model>)
analysis = AnalysisKUKAPrc(KUKAPrcAnalysisData=kuka_prc.AnalysisOutput)  # -> RobotAxisValues, RobotCollisionCheck, RobotReachabilityCheck, flatten(CommandID), TimeValue, flatten(Planes), CommandTags, IOState, Index, KRL
mesh_3 = Mesh(simplify(flatten(split_3.ListA)))
pln = Plane(flatten(fabrication_2.assembly_planes))
goal_planes = Plane(pln)
cps = ClosestPoints(Point=goal_planes, Cloud=analysis.Planes, Count=1)  # -> ClosestPoint, simplify(flatten(CPIndex)), Distance
crv_3 = Curve(crv_2)
larger = LargerThan(FirstNumber=expr("x+1", analysis.Index), SecondNumber=flatten(cps.CPIndex))  # -> LargerThan, OrEqualTo
scale = Scale(Geometry=crv_3, Center=Point(0, 0, 0), Factor=Slider(1.5, range=0..10))  # -> Geometry, Transform
data = Data(number_slider_5)
cull = CullPattern(List=flatten(mesh_3), CullPattern=larger.LargerThan)
crv_4 = Curve(crv_2)
preview_4 = CustomPreview(
    Geometry=cull,
    Material={diffuse=RGB(221, 160, 221), emission=RGB(66, 48, 66), shine=0.5, specular=RGB(255, 255, 255), transparency=0})
eval = EvaluateCurve(Curve=reparameterize(scale.Geometry), Parameter=data)  # -> Point, Tangent, Angle
eval_2 = EvaluateCurve(Curve=reparameterize(crv_4), Parameter=data)  # -> Point, Tangent, Angle
setcam = SetCamera(CameraLocation=eval.Point, TargetLocation=eval_2.Point, Activate=Toggle(False))
ln = Line(StartPoint=eval.Point, EndPoint=eval_2.Point)

kr90_kr150_r3700k_2 = QuantecKR90KR150R3700KRobot(infiniterot=False)
kr210_r3100_2_2 = Quantec2KR210R3100Robot(infiniterot=False)
kr3_r540_2 = AgilusKR3R540Robot(infiniterot=False)

# ----
# VIS
panel_5 = Panel("6")
number_slider_6 = Slider(1, range=0..1)
division_2 = Division(A=number_slider_2, B=panel_5)
split_4 = SplitList(List=geo, Index=division_2)  # -> ListA, ListB
crv_5 = Curve(<curve referenced from the Rhino model>)
mesh_4 = Mesh(simplify(flatten(split_4.ListA)))
pln_2 = Plane(flatten(fabrication.assembly_planes))

kr60l30_2 = KR60L30HARobot(infiniterot=False)
kmp_200_2 = KMP200MobilePlatformKUKAPrc(KUKAPrcRobotInput=kr60l30_2)
kuka_prc_2 = KUKAPrcCORE(
    SimulationSlider=number_slider_6,
    KUKAPrcCommands=ptp_move,
    Robot=kmp_200_2,
    PRC_BaseExpose=False,
    PRC_SaveNameExpose=False,
    PRCsettings="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")  # -> RobotGeometry, AnalysisOutput

analysis_2 = AnalysisKUKAPrc(KUKAPrcAnalysisData=kuka_prc_2.AnalysisOutput)  # -> RobotAxisValues, RobotCollisionCheck, RobotReachabilityCheck, flatten(CommandID), TimeValue, flatten(Planes), CommandTags, IOState, Index, KRL
goal_planes_2 = Plane(pln_2)
cps_2 = ClosestPoints(Point=goal_planes_2, Cloud=analysis_2.Planes, Count=1)  # -> ClosestPoint, simplify(flatten(CPIndex)), Distance
larger_2 = LargerThan(FirstNumber=expr("x+1", analysis_2.Index), SecondNumber=flatten(cps_2.CPIndex))  # -> LargerThan, OrEqualTo
cull_2 = CullPattern(List=flatten(mesh_4), CullPattern=larger_2.LargerThan)
preview_5 = CustomPreview(
    Geometry=cull_2,
    Material={diffuse=RGB(221, 160, 221), emission=RGB(66, 48, 66), shine=0.5, specular=RGB(255, 255, 255), transparency=0})

# ----
# Camera Control
number_slider_7 = Slider(1.5, range=0..10)
crv_6 = Curve(crv_5)
scale_2 = Scale(Geometry=crv_6, Center=Point(0, 0, 0), Factor=number_slider_7)  # -> Geometry, Transform
data_2 = Data(number_slider_6)
crv_7 = Curve(crv_5)
eval_3 = EvaluateCurve(Curve=reparameterize(scale_2.Geometry), Parameter=data_2)  # -> Point, Tangent, Angle
eval_4 = EvaluateCurve(Curve=reparameterize(crv_7), Parameter=data_2)  # -> Point, Tangent, Angle
setcam_2 = SetCamera(CameraLocation=eval_3.Point, TargetLocation=eval_4.Point, Activate=Toggle(False))
ln_2 = Line(StartPoint=eval_3.Point, EndPoint=eval_4.Point)

# ==== cluster Fabrication
F = ClusterInput()
pt = ClusterInput()
Z = UnitZ(Factor=F)
G = ClusterInput()
pt_2 = Point(pt)
move = Move(Geometry=pt_2, Motion=Z)  # -> Geometry, Transform
volume = Volume(Geometry=G)  # -> Volume, Centroid
ln = Line(StartPoint=move.Geometry, EndPoint=pt_2)
move_2 = Move(Geometry=volume.Centroid, Motion=Z)  # -> Geometry, Transform
ln_2 = Line(StartPoint=move_2.Geometry, EndPoint=volume.Centroid)
pframes = PerpFrames(Curve=ln, Count=1, Align=True)  # -> Frames, Parameters
pframes_2 = PerpFrames(Curve=ln_2, Count=1, Align=True)  # -> Frames, Parameters
item = ListItem(List=pframes.Frames, Index=0, Wrap=True)
item_2 = ListItem(List=pframes_2.Frames, Index=0, Wrap=True)
item_3 = ListItem(List=pframes_2.Frames, Index=1, Wrap=True)
item_4 = ListItem(List=pframes_2.Frames, Index=0, Wrap=True)
item_5 = ListItem(List=pframes.Frames, Index=1, Wrap=True)
item_6 = ListItem(List=pframes.Frames, Index=0, Wrap=True)
lng = ListLength(List=item_6)
dup = DuplicateData(Data=item_2, Number=lng, Order=True)
dup_2 = DuplicateData(Data=item_3, Number=lng, Order=True)
dup_3 = DuplicateData(Data=item_4, Number=lng, Order=True)
assembly_planes = ClusterOutput(item_5)
entwine = Entwine(Branch00=dup, Branch01=dup_2, Branch02=dup_3, Branch03=item, Branch04=item_5, Branch05=item_6, FlattenInputs=True)
flip = FlipMatrix(Data=entwine)  # -> flatten(Data)
D = ClusterOutput(flip)
